vi "802.11 Host.gvi"   [LabVIEW Communications System Design Suite 2.0.1]
# Open UDP socket used to receive UDP packets forwarded to the target TX. This node creates a packet of pseudorandom numbers in PN mode.
# Refer also to Data source in 802.11802.11 v2.0802.11 v2.0802.11 Host.gvi.
inputs:
  "Stream Selector": T11 = "Stream 1"
panel controls:
  "Trigger TX": bool
  "Clear events": bool
  "Operation Mode": T2 = "RF Loopback"
  "Primary Subband": UFXP(2.0) = 1
  "Transmit IP Address": string = "127.0.0.1"
  "Transmit Port": u16 = 12346
  "Tab": i32
  "Power Level [dBm]": f64
  "TX Frequency [Hz]": f64 = 2437000000
  "Destination MAC Address": u8[6] = [71, 111, 75, 117, 109, 98]
  "Device MAC Address": u8[6] = [71, 111, 75, 117, 109, 97]
  "TX Port (USRP only)": enum{"TX1/RF 0", "TX1/RF 1"} = "TX1/RF 0"
  "RX Port (USRP only)": T3 = "RX2/RF 1"
  "AGC": bool = TRUE
  "Manual RX gain [dB]": f64 = 37.5
  "PN Data Packet Size": i32 = 1024
  "Subcarrier Format": i32 = "20 MHz (IEEE 802.11 a)"(0)
  "Stop": bool
  "RIO Device": string = "RIO0"
  "Station": bool
  "reset TX staistics": bool
  "reset RX staistics": bool
  "PN Packets per Second": u32 = 1000
  "Transmit ACK": bool = TRUE
  "Backoff": u16 = 4
  "All": bool
  "None": bool
  "Events to Track": T5
  "CCA Energy Detection Threshold [dBm]": FXP(10.3) = -72
  "MCS": UFXP(4.0) = 4
  "session": "802.11 Host Session.gtype"
  "Data Source Option": i32 = 1
  "Data Sink Options": i32
  "Data Source": enum{"UDP", "PN Data", "Manual"} = "PN Data"
  "Data Sink": enum{"Off", "UDP"} = "Off"
  "Reference Clock": string = "Internal"
  "USRP bandwidth": "USRP bandwidth.gtype" = "40 MHz"
  "Receive Port": u16[5]
panel indicators:
  "Events": string
  "MAC TX Statistic": T1
  "Baseband Power": f64
  "Coerced LO frequency TX [Hz]": f64
  "Coerced LO frequency RX [Hz]": f64
  "Channel Estimation": cluster{"Element 1": i32[], "Element 2": f64[]}[]
  "TX Block Error Rate": f64
  "Coerced Power Level [dBm]": f64
  "RX Throughput": f64
  "Applied RX Gain [dB]": f64
  "RX Throughput [bits/s]": f64
  "Current TX Block Error Rate (BLER)": f64
  "RX Frequency [Hz]": f64
  "Overwritten by Device MAC Address": bool
  "Station Active": bool
  "Device Ready": bool
  "Baseband RX Power [dBFS]": f64
  "RX Constellation": c128[]
  "RX Power Spectrum": T4
  "TX Power Spectrum": T4
  "Data Transfer": bool
  "FIFO Full": bool
  "FIFO Full": bool
  "Data Transfer": bool
  "Compensated CFO [Hz]": f64
  "TX Data Dropped": bool
  "modulation and coding rate": string
  "MAC RX Statistic": T10
  "Target FIFO Overflow": bool
  "RF Input Power": f64[][]
types:
  T1 = cluster{"TX after SIFS Requests Detected": u32, "TX after SIFS Requests Completed": u32, "TX after Backoff Requests Detected": u32, "TX after Backoff Requests Completed": u32}
  T2 = enum{"Baseband Loopback", "RF Loopback", "RF Multi Station"}
  T3 = enum{"RX1/RF 0", "RX2/RF 0", "RX1/RF 1", "RX2/RF 1"}
  T4 = cluster{"f0": f64, "df": f64, "magnitude": f64[]}
  T5 = cluster{"PhyTxStart": bool, "PhyTxEnd": bool, "PhyRxStart": bool, "PhyRxEnd": bool, "MacChannelState": bool, "MacTxStatus": bool, "PhyCcaTiming": bool, "PhyCcaTiming_2": bool, "PhyCcaTiming_3": bool}
  T6 = cluster{"Timestamp": u32, "Transferred Bytes": u32}
  T7 = cluster{"fpga ref": any, "bus instance": u32, "instruction FIFO depth": u32, "executing on FPGA target": bool, "show error call chain": bool}
  T8 = cluster{"Actual Gain [dB]": f64, "Attenuation Table Index": i32}
  T9 = cluster{"Attenuation Table [dB]": f64[][], "Frequencies [Hz]": f64[], "IQ Imbalance Table": "niUsrpRio Config v1 Host.lvlib__IQ Imbalance.gtype"[], "Gain Table": T8[][]}
  "niInstr Register Bus v0 Host.lvlib__Register Bus Session.gtype" = Queue<"niInstr Register Bus v0 Host.lvlib__Session Data.gtype">
  "Semaphore RefNum.gtype" = i32
  "niUsrpRio Config v1 Host.lvlib__DB Queue Reference.gtype" = Queue<"niUsrpRio Config v1 Host.lvlib__Daughterboard Data.gtype">
  "niUsrpRio Config v1 Host.lvlib__niUsrpRio Session.gtype" = cluster{"FPGA Interface": any, "RIO Interface Number": u32, "Data Clock Rate": u32, "FPGA Data Clock Rate": u32, "Global Settings Register Bus": "niInstr Register Bus v0 Host.lvlib__Register Bus Session.gtype", "Radio 0 Settings Register Bus": "niInstr Register Bus v0 Host.lvlib__Register Bus Session.gtype", "Radio 1 Settings Register Bus": "niInstr Register Bus v0 Host.lvlib__Register Bus Session.gtype", "Radio Settings Bus Semaphore": "Semaphore RefNum.gtype", "DB Queues": "niUsrpRio Config v1 Host.lvlib__DB Queue Reference.gtype"[], "Characterization Data Valid?": bool, "EEPROM Header": "niUsrpRio Config v1 Host.lvlib__EEPROM Header.gtype", "Device Data Header": "niUsrpRio Config v1 Host.lvlib__EEPROM Device Data Header.gtype", "EEPROM Characterization Header": "niUsrpRio Config v1 Host.lvlib__EEPROM Characterization Header.gtype", "Characterization Data": "niUsrpRio Config v1 Host.lvlib__Characterization Data.gtype"[], "FPGA Current Version": u32, "FPGA Oldest Compatible Version": u32, "Fixed Logic Current Version": u32, "Fixed Logic Oldest Compatible Version": u32, "FPGA Radio Settings Bus Current Version": u32, "FPGA Radio Settings Bus Oldest Compatible Version": u32, "FPGA Board Config Current Version": u32, "FPGA Board Config Oldest Compatible Version": u32, "Daughterboard Clock Rate": u32}
  "802.11 Host Session.gtype" = cluster{"FPGA interface": "802.11 FGPA Reference.gtype", "send queue": Queue<u8[]>, "receive queue": Queue<u8[]>, "receive throughput queue": Queue<T6>, "UDP Receiver": UdpNetworkConnectionRefnum, "PN packet": u8[], "FlexRIO session": Queue<T7>, "FlexRIO TX Characterization Data": T9, "FlexRIO RX Characterization Data": T9, "USRP session": "niUsrpRio Config v1 Host.lvlib__niUsrpRio Session.gtype", "RF loop clock frequency": f64, "send queue_2": Queue<u8[]>, "send queue_3": Queue<u8[]>, "send queue_4": Queue<u8[]>, "send queue_5": Queue<u8[]>, "UDP Receiver_2": UdpNetworkConnectionRefnum, "UDP Receiver_3": UdpNetworkConnectionRefnum, "UDP Receiver_4": UdpNetworkConnectionRefnum, "UDP Receiver_5": UdpNetworkConnectionRefnum, "receive queue_2": Queue<u8[]>, "receive queue_3": Queue<u8[]>, "receive queue_4": Queue<u8[]>, "receive queue_5": Queue<u8[]>}
  T10 = cluster{"Packet Starts detected": u32, "Frames from PHY": u32, "Frames with FCS pass": u32, "ACKs Received": u32}
  "USRP bandwidth.gtype" = enum{"40 MHz", "120 MHz", "160 MHz"}
  T11 = enum{"Stream 1", "Stream 2", "Stream 3", "Stream 4", "Stream 5"}
  T12 = cluster{"TX after SIFS requests detected": u32, "TX after SIFS requests completed": u32, "TX after backoff requests detected": u32, "TX after backoff requests completed": u32}
  T13 = cluster{"Frames detected": u32, "Subframes received": u32, "Valid subframes received": u32, "ACKs received": u32}
  T14 = cluster{"PhyTxStart": bool, "PhyTxEnd": bool, "PhyRxStart": bool, "PhyRxEnd": bool, "MacChannelState": bool, "MacTxStatus": bool, "PhyCcaTiming": bool, "PhyRxGainChange": bool, "PhyRxAGCStateChange": bool}
  T15 = cluster{"remove header": bool, "block unsupported frame types": bool, "block FCS errors": bool, "block address mismatch": bool, "block header recognize error": bool}
diagram:
  sequence {
    frame 0 {
      $Events <- EmptyString
      $"Device Ready" <- FALSE
      $"Station Active" <- FALSE
      $Station <- FALSE
      $"RX Constellation" <- c128[] []
      $"RX Power Spectrum" <- T4 {all zero or empty}
      $"TX Power Spectrum" <- T4 {all zero or empty}
      $"Channel Estimation" <- cluster{"Element 1": i32[], "Element 2": f64[]}[] []
      $"MAC TX Statistic" <- T12 {all zero or empty}
      $"MAC RX Statistic" <- T13 {all zero or empty}
      $"Current TX Block Error Rate (BLER)" <- 0
      $"RX Throughput [bits/s]" <- 0
      $"Compensated CFO [Hz]" <- 0
      for (N = 51) {
        $"RX Throughput" <- NaN
        $"TX Block Error Rate" <- NaN
        $"Baseband Power" <- NaN
      }
      Initialize Array(element=NaN, size=51, size=2) -> w1
      $"RF Input Power" <- w1
    }
  }
  call "Create Stop Notifier.gvi"(error in=no error) -> (error out=w2)
  call "802.11 Host Init.gvi"(device=$"RIO Device", error in=w2, reference clock=$"Reference Clock", USRP bandwidth=$"USRP bandwidth") -> (session out=w3, error out=w4)
  case (w4) {
    frame Error {
      w5 = w4
    }
    frame No Error {
      $"Device Ready" <- TRUE
      $session <- w3
      w5 = w4
    }
  }
  s1 = w5  # shift register
  while {
    # RX Reception
    call "802.11 Unbundle Session.gvi"(session=$session) -> (FPGA interface=w6, receive queue=w7, receive throughput queue=w8)
    call "802.11 Receive RX ICP.gvi"(FPGA interface=w6, error in=s1, receive queue=w7, receive throughput queue=w8, enqueue decoded data=$"Station Active") -> (error out=w9)
    call "Check Stop.gvi"(error in=w9) -> (error out=w10, stop=w11)
    Wait Until Next Multiple(multiple to wait=0)
    next s1 = w10
    stop if w11
  }
  call "Stop On Error.gvi"(error in=s1) -> (error out=w12)
  s2 = w5  # shift register
  s3 = string[] []  # shift register
  while {
    call "802.11 Unbundle Session.gvi"(session=$session) -> (FPGA interface=w13)
    call "802.11 Prepare Constellation.gvi"(FPGA interface=w13, error in=s2, maximal number of subcarriers=4800) -> (error out=w14, data field constellation=w15, update constellation=w16)
    # update plots and indicators (slow)
    Logical And($"Station Active", w16) -> w17
    case (w17) {
      frame False { }
      frame True {
        $"RX Constellation" <- w15
      }
    }
    call "802.11 Read Event FIFO.gvi"(FPGA interface=w13, error in=s2) -> (raw events=w18, error out=w19)
    call "802.11 Prepare RX Power Spectrum.gvi"(FPGA interface=w13, error in=s2) -> (error out=w20, RX power spectrum=w21, update power spectrum=w22)
    call "802.11 Prepare TX Power Spectrum.gvi"(FPGA interface=w13, error in=s2) -> (error out=w23, TX power spectrum=w24, update power spectrum=w25)
    call "802.11 Prepare Channel Estimation.gvi"(FPGA interface=w13, error in=s2, channel subband=$"Primary Subband", subcarrier format=$"Subcarrier Format") -> (error out=w26, channel estimation=w27, update power spectrum=w28)
    call "802.11 Read Target Registers.gvi"(FPGA interface=w13, error in=s2) -> (error out=w29, target FIFO overflow=w30, compensated CFO=w31, RF input power=w32, MAC RX statistics=w33, MAC TX statistics=w34, signal power at packet start=w35)
    Merge Errors(w14, w20, w23, w26, w29, w19) -> (error out=w36)
    call "Check Stop.gvi"(error in=w36) -> (error out=w37, stop=w38)
    Logical And($"Station Active", w22) -> w39
    case (w39) {
      frame False, Default { }
      frame True {
        $"RX Power Spectrum" <- w21
      }
    }
    Logical And($"Station Active", w25) -> w40
    case (w40) {
      frame False, Default { }
      frame True {
        $"TX Power Spectrum" <- w24
      }
    }
    Logical And($"Station Active", w28) -> w41
    case (w41) {
      frame False, Default { }
      frame True {
        $"Channel Estimation" <- w27
      }
    }
    $"Target FIFO Overflow" <- w30
    $"Compensated CFO [Hz]" <- w31
    $"RF Input Power" <- w32
    $"Baseband Power" <- w35
    $"MAC RX Statistic" <- w33
    $"MAC TX Statistic" <- w34
    call "802.11 Events to String.gvi"(event data=w18, events to track=$"Events to Track") -> (event strings=w42)
    for {
      w43 = each element of w42
      Match Pattern(regular expression="PhyRxStart.ind ", string=w43) -> (offset past match=w45)
      Is Not Equal(x=w45, y=-1) -> w46
      append w46 to w44
    }
    Or Array Elements(Boolean array=w44)
    w47 = -12  # CFX data type offset
    Add(w35, w47) -> w48
    $"Baseband RX Power [dBFS]" <- w48
    Build Array[ConcatenateInputs=True](s3, w42) -> w49
    Delete From Array(inArray=w49, length (1)=10000) -> (deleted=w50)
    Select(s=$"Clear events", t=string[] [], f=w50) -> w51
    Concatenate Strings(w50) -> w52
    $Events <- w52
    Select(s=$None, t=T14 {all zero or empty}, f=$"Events to Track") -> w53
    w54 = T14 {"PhyTxStart"=TRUE, "PhyTxEnd"=TRUE, "PhyRxStart"=TRUE, "PhyRxEnd"=TRUE, "MacChannelState"=TRUE, "MacTxStatus"=TRUE, "PhyCcaTiming"=TRUE, "PhyRxGainChange"=TRUE, "PhyRxAGCStateChange"=TRUE}
    Select(s=$All, t=w54, f=w53) -> w55
    $"Events to Track" <- w55
    Wait Until Next Multiple(multiple to wait=250)
    next s2 = w37
    next s3 = w51
    stop if w38
  }
  call "Stop On Error.gvi"(error in=s2) -> (error out=w56)
  s4 = w5  # shift register
  while {
    Feedback Node(input=$"Station Active") -> w57
    Is Not Equal(x=$"Station Active", y=w57) -> w58
    # update plots and indicators (fast)
    case ($"Station Active") {
      frame False, Default {
        w59 = s4
      }
      frame True {
        call "802.11 Unbundle Session.gvi"(session=$session) -> (FPGA interface=w60, receive throughput queue=w61)
        call "802.11 Prepare Throughput Measurements.gvi"(reset=w58, FPGA interface=w60, receive throughput queue=w61, error in=s4, timing granularity=100) -> (error out=w59, TX block error rate=w62, RX throughput=w63)
        $"Current TX Block Error Rate (BLER)" <- w62
        $"TX Block Error Rate" <- w62
        $"RX Throughput [bits/s]" <- w63
        Divide(x=w63, y=1000000) -> w64
        $"RX Throughput" <- w64
      }
    }
    call "Check Stop.gvi"(error in=w59) -> (error out=w65, stop=w66)
    Wait Until Next Multiple(multiple to wait=100)
    next s4 = w65
    stop if w66
  }
  call "Stop On Error.gvi"(error in=s4) -> (error out=w67)
  s5 = w5  # shift register
  while {
    # TX transmission
    w68 = $session
    call "802.11 Unbundle Session.gvi"(session=w68) -> (FPGA interface=w69, send queue=w70)
    w71 = $"Station Active"
    while (after w70) {
      call "Manual Scheduler.gvi"(session=w68, Error In=s5, Selector Selector=$"Stream Selector") -> (Payload=w72, Timed Out?=w73, Error Out=w74)
      Logical And(w71, not w73) -> w75
      case (w75) {
        frame False {
          w76 = w74
        }
        frame True {
          call "802.11 Subcarrier Format to Configuration.gvi"(MCS=$MCS, subcarrier format=$"Subcarrier Format", error in=w74) -> (error out=w77, format=w78, bandwidth=w79, valid configuration=w80)
          Is Not Equal(x=$"Operation Mode", y="RF Multi Station") -> w81
          Select(s=w81, t=$"Device MAC Address", f=$"Destination MAC Address") -> w82
          case (w80) {
            frame False, Default {
              w83 = FALSE
              w76 = w77
            }
            frame True {
              call "802.11 Send TX ICP.gvi"(FPGA interface=w69, MCS=$MCS, device MAC address=$"Device MAC Address", error in=w77, destination MAC address=w82, payload=w72, format=w78, bandwidth=w79) -> (dropped?=w83, error out=w76)
            }
          }
          $"TX Data Dropped" <- w83
          $"Overwritten by Device MAC Address" <- w81
        }
      }
      call "Check Stop.gvi"(error in=w76) -> (error out=w84, stop=w85)
      Logical Or(w85, w73) -> w86
      stop if w86
    }
    call "Check Stop.gvi"(error in=w84) -> (error out=w87, stop=w88)
    Wait Until Next Multiple(multiple to wait=0)
    next s5 = w87
    stop if w88
  }
  call "Stop On Error.gvi"(error in=s5) -> (error out=w89)
  s6 = w5  # shift register
  while {
    w90 = $Station
    Feedback Node(input=w90) -> w91
    Logical Exclusive Or(w90, w91) -> w92
    case (w92) {
      frame False, Default {
        w93 = s6
      }
      frame True {
        case (w90) {
          frame False, Default {
            sequence {
              frame 0 {
                $"Station Active" <- w90
              }
            }
            call "802.11 Unbundle Session.gvi"(session=$session) -> (UDP receiver=w94)
            Udp Close(connection ID=w94, error in=s6) -> (error out=w95)
            call "Clear Errors.gvi"(specific error code to clear=1, error in=w95) -> (error out=w96)
            call "802.11 Abort RF Streams.gvi"(session=$session, error in=w96) -> (error out=w93)
          }
          frame True {
            w97 = 4061  # packet size in byte
            call "802.11 Random Bit Generator.gvi"(packet size=w97) -> (random array=w98)
            call "802.11 FPGA Target Configuration.gvi"() -> (maximum gain=w99, enable DC offset correction=w100)
            w101 = T15 {"remove header"=TRUE, "block unsupported frame types"=TRUE, "block FCS errors"=TRUE, "block address mismatch"=TRUE, "block header recognize error"=TRUE}
            call "802.11 Configure Static Parameters.gvi"(session in=$session, error in=s6, primary subband=$"Primary Subband", operation mode=$"Operation Mode", enable DC offset correction=w100, MPDU filter configuration=w101, device MAC address=$"Device MAC Address") -> (session dup=w102, error out=w103)
            call "802.11 Reset Statistics.gvi"(session in=w102, error in=w103, reset RX statistics=TRUE, reset TX statistics=TRUE) -> (error out=w104, session dup=w105)
            call "802.11 Configure TX RF.gvi"(TX port=$"TX Port (USRP only)", session=w105, TX frequency=$"TX Frequency [Hz]", TX power level=$"Power Level [dBm]", error in=w104) -> (session dup=w106, error out=w107, coerced TX power level=w108, coerced LO frequency=w109)
            call "802.11 Configure RX RF.gvi"(RX frequency=$"TX Frequency [Hz]", session=w106, RX gain=w99, error in=w107, RX port=$"RX Port (USRP only)") -> (error out=w110, session dup=w111, coerced RX gain=w112, coerced LO frequency=w113)
            call "802.11 Configure AGC Registers.gvi"(TX Port=$"TX Port (USRP only)", enable AGC=FALSE, session=w111, RX port=$"RX Port (USRP only)", error in=w110) -> (error out=w114, session dup=w115)
            call "802.11 Set Power Calibration Offset.gvi"(session=w115, frequency=$"TX Frequency [Hz]", error in=w114, RX port=$"RX Port (USRP only)") -> (session dup=w116, error out=w117)
            call "802.11 Configure RF Streams.gvi"(TX port=$"TX Port (USRP only)", RX port=$"RX Port (USRP only)", session=w116, error in=w117) -> (session dup=w118, error out=w119)
            Property Node(instance in=w118) -> ("UDP Receiver"=w120, "UDP Receiver_2"=w121, "UDP Receiver_3"=w122, "UDP Receiver_4"=w123, "UDP Receiver_5"=w124)
            Array Index(array=$"Receive Port") -> (out0[1]=w125)
            call "802.11 Configure Data Source.gvi"(error in=w119, receive port=w125, UDP Receiver 1=w120) -> (error out=w126, UDP Receiver out 1=w127, success?=w128)
            Array Index(array=$"Receive Port") -> (out0[2]=w129)
            call "802.11 Configure Data Source_2.gvi"(receive port=w129, UDP Receiver 2=w121) -> (error out=w130, UDP Receiver out 2=w131, success?=w132)
            Array Index(array=$"Receive Port") -> (out0[3]=w133)
            call "802.11 Configure Data Source_3.gvi"(receive port=w133, UDP Receiver 3=w122) -> (error out=w134, UDP Receiver out 3=w135, success?=w136)
            Array Index(array=$"Receive Port") -> (out0[4]=w137)
            call "802.11 Configure Data Source_4.gvi"(receive port=w137, UDP Receiver 4=w123) -> (error out=w138, UDP Receiver out 4=w139, success?=w140)
            # Yue 09/14/2017
            # 1. create 5 UDP Sources
            # 2. make the receive port as a vector
            Array Index(array=$"Receive Port") -> (out0[5]=w141)
            call "802.11 Configure Data Source_5.gvi"(receive port=w141, UDP Receiver 5=w124) -> (error out=w142, UDP Receiver out 5=w143, success?=w144)
            Property Node(instance in=$session, "PN packet"=w98, "UDP Receiver"=w127, "UDP Receiver_2"=w131, "UDP Receiver_3"=w135, "UDP Receiver_4"=w139, "UDP Receiver_5"=w143) -> (instance out=w145)
            $session <- w145
            $"RX Frequency [Hz]" <- $"TX Frequency [Hz]"
            Merge Errors(w126, w130, w134, w138, w142) -> (error out=w93)
            Logical And(w128, w132, w136, w140, w144) -> w146
            sequence {
              frame 0 {
                $Station <- w146
                $"Station Active" <- w90
              }
            }
            $"Coerced LO frequency RX [Hz]" <- w113
            $"Applied RX Gain [dB]" <- w112
            $"Coerced LO frequency TX [Hz]" <- w109
            $"Coerced Power Level [dBm]" <- w108
          }
        }
      }
    }
    # configuration
    call "802.11 Unbundle Session.gvi"(session=$session) -> (FPGA interface=w147)
    Feedback Node(input=$"Station Active") -> w148
    case ($"Station Active") {
      frame False, Default {
        w149 = s6
      }
      frame True {
        Is Not Equal(x=$"Station Active", y=w148) -> w150
        call "802.11 Gain Control.gvi"(initialize=w150, RX Port (USRP only)=$"RX Port (USRP only)", session=$session, AGC=$AGC, error in=s6, Manual RX gain [dB]=$"Manual RX gain [dB]", RX Frequency [Hz]=$"RX Frequency [Hz]", TX Port (USRP only)=$"TX Port (USRP only)") -> (Applied RX Gain [dB]=w151, error out=w152)
        $"Applied RX Gain [dB]" <- w151
        call "802.11 Subcarrier Format to Configuration.gvi"(MCS=$MCS, subcarrier format=$"Subcarrier Format", error in=s6) -> (error out=w153, format=w154)
        call "802.11 Configure Dynamic Parameters.gvi"(FPGA interface=w147, error in=w153, format=w154, transmit ACK=$"Transmit ACK", backoff value=$Backoff, CCA energy detection threshold=$"CCA Energy Detection Threshold [dBm]") -> (error out=w155)
        Merge Errors(w152, w155) -> (error out=w149)
      }
    }
    call "802.11 Reset Statistics.gvi"(session in=$session, error in=s6, reset RX statistics=$"reset RX staistics", reset TX statistics=$"reset TX staistics") -> (error out=w156)
    call "802.11 Subcarrier Format to Configuration.gvi"(MCS=$MCS, subcarrier format=$"Subcarrier Format", error in=w156) -> (modulation and coding rate=w157, error out=w158)
    Merge Errors(w149, w93, w158) -> (error out=w159)
    call "Create Stop.gvi"(error in=w159, stop in=$Stop) -> (error out=w160)
    call "Check Stop.gvi"(error in=w160) -> (error out=w161, stop=w162)
    Wait Until Next Multiple(multiple to wait=100)
    $"modulation and coding rate" <- w157
    next s6 = w161
    stop if w162
  }
  call "Stop On Error.gvi"(error in=s6) -> (error out=w163)
  Udp Open(error in=w5, net address=0, port=0, service name="", timeout ms=25000) -> (connection ID=w164, error out=w165)
  call "Set Socket Option.gvi"(connection in=w164, level=0xFFFF, option name=0x1001, value=1024000, error in=w165) -> (error out=w166, connection out=w167)
  s7 = w166  # shift register
  s8 = w167  # shift register
  while {
    Wait Until Next Multiple(multiple to wait=0)
    # UDP send and receive
    call "802.11 Unbundle Session.gvi"(session=$session) -> (send queue=w168, receive queue=w169, PN packet=w170)
    case ($"Station Active") {
      frame False, Default {
        w171 = s7
        w172 = s8
      }
      frame True {
        Array Subset(array=w170, length0=$"PN Data Packet Size") -> w173
        case ($"Data Source") {
          frame "UDP" {
            # UDP
            Property Node(instance in=$session) -> ("UDP Receiver_5"=w176, "UDP Receiver_4"=w177, "UDP Receiver_4"=w178, "UDP Receiver_2"=w179, "UDP Receiver"=w180)
            Property Node(instance in=$session) -> ("send queue_5"=w181, "send queue_4"=w182, "send queue_3"=w183, "send queue_2"=w184, "send queue"=w185)
            call "802.11 Receive UDP Data.gvi"(UDP receiver=w180, send queue=w185, error in=s7) -> (data transfer=w186, error out=w187, FIFO full=w188)
            call "802.11 Receive UDP Data_2.gvi"(UDP receiver=w179, send queue=w184, error in=s7) -> (data transfer=w189, error out=w190, FIFO full=w191)
            call "802.11 Receive UDP Data_3.gvi"(UDP receiver=w178, send queue=w183, error in=s7) -> (data transfer=w192, error out=w193, FIFO full=w194)
            call "802.11 Receive UDP Data_4.gvi"(UDP receiver=w177, send queue=w182, error in=s7) -> (data transfer=w195, error out=w196, FIFO full=w197)
            call "802.11 Receive UDP Data_5.gvi"(UDP receiver=w176, send queue=w181, error in=s7) -> (data transfer=w198, error out=w199, FIFO full=w200)
            # Yue 09/14/2017
            # 1. put 5 queues into recerive UDP DATA block
            Logical And(w186, w189, w192, w195, w198) -> w175
            Merge Errors(w199, w196, w193, w190, w187) -> (error out=w174)
            Logical And(w200, w197, w194, w191, w188) -> w201
            $"FIFO Full" <- w201
          }
          frame "PN Data" {
            # PN data
            call "802.11 Send PN Data.gvi"(PN packets per second=$"PN Packets per Second", send queue=w168, PN data=w173, error in=s7) -> (data transfer=w175, error out=w174)
          }
          frame "Manual", Default {
            # Manual
            case ($"Trigger TX") {
              frame False, Default {
                w174 = s7
                w175 = $"Trigger TX"
              }
              frame True {
                Enqueue Element(element=w173, error in=s7, queue=w168, timeout in ms=-1) -> (error out=w174, queue out=w202)
                w175 = $"Trigger TX"
              }
            }
          }
        }
        $"Data Transfer" <- w175
        Is Equal(x=$"Data Sink", y="UDP") -> w203
        call "802.11 Send UDP Data.gvi"(target port=$"Transmit Port", target IP address=$"Transmit IP Address", receive queue=w169, UDP sender=s8, enable=w203, error in=s7) -> (FIFO full=w204, error out=w205, UDP sender dup=w172, data transfer=w206)
        $"Data Transfer" <- w206
        $"FIFO Full" <- w204
        Merge Errors(w174, w205) -> (error out=w171)
      }
    }
    call "Check Stop.gvi"(error in=w171) -> (error out=w207, stop=w208)
    next s7 = w207
    next s8 = w172
    stop if w208
  }
  call "Stop On Error.gvi"(error in=s7) -> (error out=w209)
  Udp Close(connection ID=s8, error in=w209) -> (error out=w210)
  Merge Errors(w163, w89, w12, w210, w56, w67) -> (error out=w211)
  sequence {
    frame 0 {
      w212 = $session
    }
  }
  call "802.11 Host Release.gvi"(session=w212, error in=w211) -> (error out=w213)
  call "Simple Error Handler.gvi"(type of dialog="OK message", error in=w213)
