vi "Manual Scheduler output.gvi"   [LabVIEW Communications System Design Suite 2.0.1]
inputs:
  "FPGA interface": "802.11 FGPA Reference.gtype"  # Interface to the device's FPGA handle.
  "receive queue": Queue<u8[]>  # Queue to store the payload.
  "receive throughput queue": Queue<T2>  # Queue to store statistical information about the payload (time stamp and size).
  "Station Active": bool
  "error in": error
outputs:
  "decoded": bool  # Indicates that an ICP packet was successfully decoded.
  "error out": error
panel controls:
  "Output Selector": T1 = "Stream 1"
types:
  T1 = enum{"Stream 1", "Stream 2", "Stream 3", "Stream 4", "Stream 5"}
  T2 = cluster{"Timestamp": u32, "Transferred Bytes": u32}
diagram:
  w1 = "Stream 1"  # Stream ID
  Feedback Node(initial value=w1, input=$"Output Selector") -> w2
  case (w2) {
    frame "Stream 1", Default {
      call "802.11 Receive RX ICP.gvi"(FPGA interface=$"FPGA interface", error in=$"error in", receive queue=$"receive queue", receive throughput queue=$"receive throughput queue", enqueue decoded data=$"Station Active") -> (error out=w4, decoded=w3)
    }
    frame "Stream 2" {
      call "802.11 Receive RX ICP_2.gvi"(FPGA interface=$"FPGA interface", error in=$"error in", receive queue=$"receive queue", receive throughput queue=$"receive throughput queue", enqueue decoded data=$"Station Active") -> (error out=w4, decoded=w3)
    }
    frame "Stream 3" {
      call "802.11 Receive RX ICP_3.gvi"(FPGA interface=$"FPGA interface", error in=$"error in", receive queue=$"receive queue", receive throughput queue=$"receive throughput queue", enqueue decoded data=$"Station Active") -> (error out=w4, decoded=w3)
    }
    frame "Stream 4" {
      call "802.11 Receive RX ICP_4.gvi"(FPGA interface=$"FPGA interface", error in=$"error in", receive queue=$"receive queue", receive throughput queue=$"receive throughput queue", enqueue decoded data=$"Station Active") -> (error out=w4, decoded=w3)
    }
    frame "Stream 5" {
      call "802.11 Receive RX ICP_5.gvi"(FPGA interface=$"FPGA interface", error in=$"error in", receive queue=$"receive queue", receive throughput queue=$"receive throughput queue", enqueue decoded data=$"Station Active") -> (error out=w4, decoded=w3)
    }
  }
  $decoded <- w3
  $"error out" <- w4
